# Grasshopper definition AddBuildingVolume.gh (Grasshopper 1.0.7)
# plug-ins: RhinoCityJSON

# ---- group: Adjust to file!
toggle = BooleanToggle(False)
toggle_2 = BooleanToggle(True)
path = FilePath()
pt = Point(Point(0, 0, 0))
panel = Panel("50")
panel_2 = Panel("1.3")

# ----
rsettings = SettingsReader(Translate=toggle_2, ModelOrigin=pt, TrueNorth=panel, LoD=panel_2, LargeFiles=False)
oreader = ReaderObjects(Path=path, Activate=toggle, Settings=rsettings)  # -> Geometry, SurfaceInformation, ObjectInformation

# ---- group: Select surfaces per object and join
surface_filter = SurfaceKeys({"Object Name", "Geometry Type", "Geometry Name", "Geometry LoD", "Surface Material", "Surface type", "Surface Direction", "Surface Slope"}, selected="Object Name")
selector = AttributeSelector(InformationObjects=oreader.SurfaceInformation, AttributeName=surface_filter)  # -> flatten(Attribbutes)
cset = CreateSet(List=selector)  # -> Set, Map
mindex = MemberIndex(Set=selector, Member=cset.Set)  # -> Index, Count
item = ListItem(List=oreader.Geometry, Index=mindex.Index, Wrap=True)
join = BrepJoin(Breps=item)  # -> Breps, Closed
item_2 = ListItem(List=join.Breps, Index=0, Wrap=True)

# ---- group: Compute and add volume value
volume = Volume(Geometry=item_2)  # -> Volume, Centroid
add = AttributeAdd(InformationObjects=oreader.ObjectInformation, AttributeName="Object Volume", AttributeValue=volume.Volume)

# ----
imanage = InformationManager(Geometry=oreader.Geometry, SurfaceInfo=oreader.SurfaceInformation, ObjectInfo=add)  # -> Geometry, MergedSurfaceInformation
baking = Bakery(Geometry=imanage.Geometry, MergedSurfaceInfo=imanage.MergedSurfaceInformation, Activate=Button())
