# Grasshopper definition AddSurfaceArea.gh (Grasshopper 1.0.7)
# plug-ins: RhinoCityJSON

# ---- group: Adjust to file!
toggle = BooleanToggle(False)
path = FilePath()
pt = Point(Point(0, 0, 0))
panel = Panel("50")
panel_2 = Panel("1.3")

# ----
rsettings = ReaderSettings(Translate=toggle, ModelOrigin=pt, TrueNorth=panel, LoD=panel_2)
reader = RCJReader(Path=path, Activate=Toggle(True), Settings=rsettings)  # -> Geometry, SurfaceInfoKeys, SurfaceInfoValues, ObjectInfoKeys, ObjectInfoValues

# ---- group: Add the Area Key
merge = Merge(Data1=reader.SurfaceInfoKeys, Data2=graft("Surface Area"))

# ---- group: Add the Area Value
area = Area(Geometry=reader.Geometry)  # -> simplify(graft(Area)), Centroid

# ----
merge_2 = Merge(Data1=reader.SurfaceInfoValues, Data2=area.Area)
imanage = InformationManager(
    Geometry=reader.Geometry,
    SurfaceInfoKeys=merge,
    SurfaceInfoValues=merge_2,
    ObjectInfoKeys=reader.ObjectInfoKeys,
    ObjectInfoValues=reader.ObjectInfoValues)  # -> Geometry, MergedSurfaceInfoKeys, MergedSurfaceInfoValues
baking = Bakery(
    Geometry=imanage.Geometry,
    SurfaceInfoKeys=imanage.MergedSurfaceInfoKeys,
    SurfaceInfo=imanage.MergedSurfaceInfoValues,
    Activate=Button())
