# Grasshopper definition IsolateRooftypes.gh (Grasshopper 1.0.7)
# plug-ins: RhinoCityJSON

# ---- group: Adjust to file!
toggle = BooleanToggle(False)
path = FilePath()
pt = Point(Point(0, 0, 0))
panel = Panel("50")
panel_2 = Panel("1.3")

# ----
rsettings = ReaderSettings(Translate=toggle, ModelOrigin=pt, TrueNorth=panel, LoD=panel_2)
reader = RCJReader(Path=path, Activate=Toggle(True), Settings=rsettings)  # -> Geometry, SurfaceInfoKeys, SurfaceInfoValues, ObjectInfoKeys, ObjectInfoValues

# ---- group: Based on the surface keys/value the surface type can be isolated
panel_3 = Panel(reader.ObjectInfoKeys)
filter = Filter(
    InfoKeys=reader.ObjectInfoKeys,
    InfoValues=reader.ObjectInfoValues,
    FilterInfoKey="Object dak_type",
    FilterInfoValueS="multiple horizontal",
    EqualsNotEquals=True)

# ---- group: IManage resolves the geometry filtering
imanage = InformationManager(
    Geometry=reader.Geometry,
    SurfaceInfoKeys=reader.SurfaceInfoKeys,
    SurfaceInfoValues=reader.SurfaceInfoValues,
    ObjectInfoKeys=reader.ObjectInfoKeys,
    ObjectInfoValues=filter)  # -> Geometry, MergedSurfaceInfoKeys, MergedSurfaceInfoValues
preview = CustomPreview(Geometry=imanage.Geometry, Material=ColourSwatch(SwatchColor=RGB(255, 255, 0)))
