# Grasshopper definition ReadAndBakeFile.gh (Grasshopper 1.0.7)
# plug-ins: RhinoCityJSON

# ---- group: Adjust to file!
toggle = BooleanToggle(False)
path = FilePath()
pt = Point(Point(0, 0, 0))
panel = Panel("50")
panel_2 = Panel("1.3")

# ----
toggle_2 = BooleanToggle(True)
rsettings = SettingsReader(Translate=toggle, ModelOrigin=pt, TrueNorth=panel, LoD=panel_2, LargeFiles=False)
treader = ReaderTemplates(Path=path, Activate=toggle_2, Settings=rsettings)  # -> TemplateGeometry, SurfaceInformation, ObjectInformation
oreader = ReaderObjects(Path=path, Activate=toggle_2, Settings=rsettings)  # -> Geometry, SurfaceInformation, ObjectInformation
dreader = ReaderDocuments(Path=path, Activate=toggle_2, Settings=rsettings)  # -> MetadataInformation, LoD, Materials, Domain
button = Button()
imanage = InformationManager(Geometry=oreader.Geometry, SurfaceInfo=oreader.SurfaceInformation, ObjectInfo=oreader.ObjectInformation)  # -> Geometry, MergedSurfaceInformation
baking = Bakery(
    Geometry=imanage.Geometry,
    MergedSurfaceInfo=imanage.MergedSurfaceInformation,
    Materials=dreader.Materials,
    Activate=button)
tbakery = TemplateBakery(
    Geometry=treader.TemplateGeometry,
    SurfaceInformation=treader.SurfaceInformation,
    ObjectInformation=treader.ObjectInformation,
    Materials=dreader.Materials,
    Activate=button)
